# Grasshopper definition galapagos_lb.gh (Grasshopper 1.0.7)

number_slider = Slider(1, range=1..100)
curve = Curve(<curve referenced from the Rhino model>)
curve_2 = Curve(<curve referenced from the Rhino model>)
divide_curve = DivideCurve(Curve=curve, Count=number_slider, Kinks=False)  # -> Points, Tangents, Parameters

# ---- group: Criação dos eixos dos montantes
divide_curve_2 = DivideCurve(Curve=curve_2, Count=number_slider, Kinks=False)  # -> Points, Tangents, Parameters
line = Line(StartPoint=divide_curve_2.Points, EndPoint=divide_curve.Points)

# ----
panel = Panel(curve_2)
ladybug = Ladybug_Ladybug()  # -> out; plug-in component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
downloadepw = Ladybug_downloadEPWWeatherFile(download=Toggle(False))  # -> Output; plug-in component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
panel_2 = Panel(ladybug)
panel_3 = Panel(divide_curve_2.Points)
panel_4 = Panel(downloadepw)
number_slider_2 = Slider(10, range=0..100)

# ---- group: Manipulação da lista de eixos de pilares
cull_index = CullIndex(List=line, Indices=number_slider, Wrap=True)
cull_index_2 = CullIndex(List=line, Indices="0", Wrap=True)

# ---- group: Eixos das aletas do brise
divide_curve_3 = DivideCurve(Curve=cull_index, Count=number_slider_2, Kinks=False)  # -> Points, Tangents, Parameters
divide_curve_4 = DivideCurve(Curve=cull_index_2, Count=number_slider_2, Kinks=False)  # -> Points, Tangents, Parameters
line_2 = Line(StartPoint=divide_curve_3.Points, EndPoint=divide_curve_4.Points)

# ---- group: Criação das aletas
construct_plane = ConstructPlane(Origin=divide_curve_3.Points, XAxis=line_2, YAxis=divide_curve_3.Tangents)
deconstruct_plane = DeconstructPlane(Plane=construct_plane)  # -> Origin, XAxis, YAxis, ZAxis
construct_plane_2 = ConstructPlane(Origin=deconstruct_plane.Origin, XAxis=deconstruct_plane.ZAxis, YAxis=deconstruct_plane.YAxis)
number_slider_3 = Slider(0.39, range=0..1)
number_slider_4 = Slider(0.05, range=0..1)
number_slider_5 = Slider(-30, range=-360..360)
cluster_retangulo_eixo = ClusterRetanguloEixo(plane=construct_plane_2, angle=number_slider_5, dim_x=number_slider_3, dim=number_slider_4)
extrude_along = ExtrudeAlong(Base=cluster_retangulo_eixo, Curve=line_2)
cap_holes = CapHoles(Brep=extrude_along)

# ----
panel_5 = Panel("https://www.energyplus.net/weather-download/south_america_wmo_region_3/BRA//BRA_Salvador.832290_SWERA/all")
epw_stat = Ladybug_OpenEPWAndSTATWeatherFiles(weatherFileURL=panel_5)  # -> epwFile, statFile; plug-in component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

boolean_toggle = BooleanToggle(False)
boolean_toggle_2 = BooleanToggle(True)

gencumulativeskymtx = Ladybug_GenCumulativeSkyMtx(epwFile=epw_stat.epwFile, skyDensity=0, useOldRes=True, runIt=Toggle(True))  # -> out, cumulativeSkyMtx; plug-in component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

# ---- group: Norte
curve_3 = Curve(<curve referenced from the Rhino model>)
end_points = EndPoints(Curve=curve_3)  # -> Start, End
vector_2pt = Vector2Pt(PointA=end_points.Start, PointB=end_points.End, Unitize=False)  # -> Vector, Length
northarrow = Ladybug_North(north=vector_2pt.Vector, centerPt=end_points.Start, scale=Slider(4, range=0.001..10))  # -> northSign; plug-in component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

# ---- group: CONTEXT
brep = Brep([<brep referenced from the Rhino model> x2])

# ----
merge = Merge(Data1=brep, Data2=cap_holes)
number_slider_6 = Slider(1, range=0.01..2)
number_slider_7 = Slider(5, range=1..100)

# ---- group: GEOMETRY
brep_2 = Brep(<brep referenced from the Rhino model>)

# ---- group: DIRECT
selectskymtx = Ladybug_selectSkyMtx(cumulativeSkyMtx=gencumulativeskymtx.cumulativeSkyMtx, removeDiffuse=boolean_toggle_2, removeDirect=False)  # -> out, selectedSkyMtx; plug-in component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
radiationanalysis = Ladybug_RadiationAnalysis(
    north=vector_2pt.Vector,
    geometry=flatten(brep_2),
    context=flatten(merge),
    gridSize=number_slider_7,
    disFromBase=number_slider_6,
    selectedSkyMtx=flatten(selectskymtx.selectedSkyMtx),
    runIt=boolean_toggle)  # -> out, contextMesh, analysisMesh, testPts, testVec, port, radiationResult, radiationMesh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; plug-in component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

# ---- group: DIFFUSE
selectskymtx_2 = Ladybug_selectSkyMtx(cumulativeSkyMtx=gencumulativeskymtx.cumulativeSkyMtx, removeDiffuse=False, removeDirect=boolean_toggle_2)  # -> out, selectedSkyMtx; plug-in component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
radiationanalysis_2 = Ladybug_RadiationAnalysis(
    north=vector_2pt.Vector,
    geometry=flatten(brep_2),
    context=flatten(merge),
    gridSize=number_slider_7,
    disFromBase=number_slider_6,
    selectedSkyMtx=flatten(selectskymtx_2.selectedSkyMtx),
    runIt=boolean_toggle)  # -> out, contextMesh, analysisMesh, testPts, testVec, port, radiationResult, radiationMesh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; plug-in component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

# ----
subtraction = Subtraction(A=radiationanalysis_2.totalRadiation, B=radiationanalysis.totalRadiation)
panel_6 = Panel(subtraction)
galapagos = Galapagos(fitness=subtraction, gene=[number_slider_2, number_slider_3, number_slider_4, number_slider_5])

# ==== cluster ClusterRetanguloEixo
dim_x = ClusterInput()
plane = ClusterInput()
angle = ClusterInput()
dim = ClusterInput()
rotate_plane = RotatePlane(Plane=plane, Angle=degrees(angle))
dim_x_2 = Number(dim_x)
dim_2 = Number(dim)
division = Division(A=dim_2, B="2")
division_2 = Division(A=dim_x_2, B="2")
negative = Negative(Value=division_2)
negative_2 = Negative(Value=division)
construct_domain = ConstructDomain(DomainStart=negative_2, DomainEnd=division)
construct_domain_2 = ConstructDomain(DomainStart=negative, DomainEnd=division_2)
rectangle = Rectangle(Plane=rotate_plane, XSize=construct_domain_2, YSize=construct_domain, Radius=0)  # -> Rectangle, Length
rectangle_2 = ClusterOutput(rectangle.Rectangle)
